% Simulink data dictionary JointData.sldd

ia = Simulink.Signal(DataType="single")
ib = Simulink.Signal(DataType="single")
ic = Simulink.Signal(DataType="single")
Rs = Simulink.Parameter(6.97, DataType="single")
L = Simulink.Parameter(0.00535, DataType="single")
ThetaOpen = Simulink.Signal(DataType="single")
spd_kp = Simulink.Parameter(0.3389, DataType="single")
spd_ki = Simulink.Parameter(0.0144, DataType="single")
Udc = Simulink.Parameter(24)
CurrKp = Simulink.Parameter(0.26, DataType="single")
CurrKi = Simulink.Parameter(35, DataType="single")
Pn = Simulink.Parameter(2)
flux = Simulink.Parameter(0.008442, DataType="single")